# Dynamo graph 001_drill_01_mapping.dyn (Dynamo 3.3.0.6316)

categories = Categories("OST_Walls")
all_elements_of_category = ElementsOfCategory(Category=categories)
name = Element.Name(element=all_elements_of_category)
python_script = Python(IN[0]=name)  # CPython3
# ---------- python_script.python (40 lines) ----------
# Load the Python Standard and DesignScript Libraries
import sys
import clr
clr.AddReference('ProtoGeometry')
from Autodesk.DesignScript.Geometry import *

# The inputs to this node will be stored as a list in the IN variables.
dataEnteringNode = IN

# Place your code below this line

# Assign your output to the OUT variable.
OUT = 0


# drill_01_mapping

input_materials = IN[0]

# define the MasterFormat mapping dictionary
material_map = {
    'Exterior Curtain Wall':'08 44 00',
    'Generic - 200mm':'03 30 00',
    'Storefront':'08 41 00',
}

# function encapsulation
# function: safely maps material names to MasterFormat standard codes.
def map_material_code(material_name):
    cleaned_name = material_name.strip()
    standard_code = material_map.get(cleaned_name,'NO STANDARD code')
    return standard_code

# test input list and output results
output_codes = []
for material in input_materials:
    code = map_material_code(material)
    output_codes.append(code)

OUT = output_codes
# ----------------------------------------
watch = Watch(python_script)
