# Dynamo graph 002_drill_01_batch_mapping.dyn (Dynamo 3.3.0.6316)

categories = Categories("OST_Doors")
all_elements_of_category = ElementsOfCategory(Category=categories)
elementType = Element.ElementType(element=all_elements_of_category)
parameters = Element.Parameters(element=elementType)
name = Parameter.Name(parameter=parameters)
flatten = List.Flatten(list=name)
python_script = Python(IN[0]=flatten)  # CPython3
# ---------- python_script.python (59 lines) ----------
# Load the Python Standard and DesignScript Libraries
import sys
import clr
clr.AddReference('ProtoGeometry')
from Autodesk.DesignScript.Geometry import *

# The inputs to this node will be stored as a list in the IN variables.
dataEnteringNode = IN

# Place your code below this line

# Assign your output to the OUT variable.
OUT = 0


# drill_01_batch_parameter_mapping

raw_parameters_batch = IN[0]

# define standards (some enterprise standard Set)
standard_parameters = {
    'Height',
    'Width',
    'Fire_Rating',
    'Material_Finish'
}

# define the safe mapping dictionary
safe_map = {
    'height':'Height',
    'width':'Width',
    'firerating':'Fire_Rating',
    'matlfnish':'Material_Finish',
    ' fire rating ':'Fire_Rating',
    'width_mm':'Width'
}

# define the batch safe mapping function
def batch_safe_map(raw_param, safe_map, standard_parameters):
    # raw_param (str), safe_map (dict), standard_parameters (set)
    # raw_param is a placeholder
    cleaned_key = raw_param.strip().lower()
    mapped_param = safe_map.get(cleaned_key)

    if mapped_param:
        return mapped_param
    elif raw_param in standard_parameters:
        return raw_param
    else:
        return None

# loop through the input data & get result list
final_mapped_results = []

for raw_name in raw_parameters_batch:
    mapped_result = batch_safe_map(raw_name, safe_map, standard_parameters)
    final_mapped_results.append(mapped_result)

OUT = final_mapped_results
# ----------------------------------------
