# Dynamo graph 003_drill_02_string_cleaning_(view_name).dyn (Dynamo 3.3.0.6316)

categories = Categories("OST_Views")
all_elements_of_category = ElementsOfCategory(Category=categories)
string = StringInput("View Name")
name = Element.Name(element=all_elements_of_category)
trimWhitespace = String.TrimWhitespace(string=name)
toUpper = String.ToUpper(string=trimWhitespace)
setParameterByName = Element.SetParameterByName(element=all_elements_of_category, parameterName=string, value=toUpper)
