# Dynamo graph 004_drill_2A_string_cleaning_(family name).dyn (Dynamo 3.3.0.6316)

categories = Categories("OST_Walls")
all_elements_of_category = ElementsOfCategory(Category=categories)
name = Element.Name(element=all_elements_of_category)
code_block = CodeBlock { ["E","I"]; }
python_script = Python(IN[0]=name, IN[1]=code_block)  # CPython3
# ---------- python_script.python (52 lines) ----------
# Load the Python Standard and DesignScript Libraries
import sys
import clr
clr.AddReference('ProtoGeometry')
from Autodesk.DesignScript.Geometry import *

# The inputs to this node will be stored as a list in the IN variables.
dataEnteringNode = IN

# Place your code below this line

# Assign your output to the OUT variable.
OUT = 0


# drill_2A_string_cleaning_(family_name)

# define standards (suppose Wall family names: Exterior-,Interior-)
standard_prefixes = IN[1]

# name data exported from Revit
raw_family_names_from_revit = IN[0]

# define function to strip spaces, covert to uppercase, check prefix
# and to return the cleaned names or None
def clean_and_check(raw_family_name:str, valid_prefixes:list) -> str or None:
    if not isinstance(raw_family_name, str):
        return None

    cleaned_name = raw_family_name.strip().upper()

    is_valid = False

    for prefix in valid_prefixes:
        if cleaned_name.startswith(prefix):
            is_valid = True
            break

    if is_valid == True:
        return cleaned_name
    else:
        return None

# batch execution, iterate through the list of raw names
validated_names = []

for name in raw_family_names_from_revit:
    cleaned_name = clean_and_check(name, standard_prefixes)

    validated_names.append(cleaned_name)
    
OUT = validated_names
# ----------------------------------------
isNull = Object.IsNull(object=python_script)
not_ = Not(x=isNull)
filterByBoolMask = List.FilterByBoolMask(list=name, mask=not_)
watch = Watch(filterByBoolMask.in)
watch_2 = Watch(filterByBoolMask.out)
