# Dynamo graph 005_drill_2B_string_cleaning_(parameter name).dyn (Dynamo 3.3.0.6316)

# group: Extract Instance Parameter directly. -> Success Extract Type Parameter directly. -> Failure
select_model_element = DSModelElementSelection()  # 1 picked in the model
code_block = CodeBlock { "Thickness"; }
getParameterValueByName = Element.GetParameterValueByName(element=select_model_element, parameterName=code_block)
select_model_element_2 = DSModelElementSelection()  # 1 picked in the model
code_block_2 = CodeBlock { "Mark"; }
getParameterValueByName_2 = Element.GetParameterValueByName(element=select_model_element_2, parameterName=code_block_2)

select_model_element_3 = DSModelElementSelection()  # 1 picked in the model
elementType = Element.ElementType(element=select_model_element_3)
code_block_3 = CodeBlock { ["Door Material","Frame Material"]; }
getParameterValueByName_3 = Element.GetParameterValueByName(element=elementType, parameterName=code_block_3)
name = Element.Name(element=getParameterValueByName_3)
python_script = Python(IN[0]=name)  # CPython3
# ---------- python_script.python (41 lines) ----------
# Load the Python Standard and DesignScript Libraries
import sys
import clr
clr.AddReference('ProtoGeometry')
from Autodesk.DesignScript.Geometry import *

# The inputs to this node will be stored as a list in the IN variables.
dataEnteringNode = IN

# Place your code below this line

# Assign your output to the OUT variable.
OUT = 0


# drill_2B_string_cleaning_(parameter_name)

# name data exported from Revit
raw_parameter_names = IN[0]

# list of illegal characters or delimiters (should be replaced with '_')
# a common requirement for data cleaning
illegal_characters = [':', ' ', '/', '[', ']', '(', ')', '.', '°', '-']

# use a loop to iterate through each raw parameter
standardized_list = []

for index, raw_param in enumerate(raw_parameter_names):
    standardized_param = str(raw_param).lower()

    for char in illegal_characters:
        standardized_param = standardized_param.replace(char, '_')

    while '__' in standardized_param:
        standardized_param = standardized_param.replace('__','_')

    standardized_param = standardized_param.strip('_')
    
    standardized_list.append(standardized_param)
    
OUT = standardized_list
# ----------------------------------------
byName = Material.ByName(name=python_script)
setParameterByName = Element.SetParameterByName(element=elementType, parameterName=code_block_3, value=byName)
