# Dynamo graph 006_drill_3A_list_operation_(filter_data).dyn (Dynamo 3.3.0.6316)

categories = Categories("OST_Doors")
categories_2 = Categories("OST_Windows")
code_block = CodeBlock(x=categories, y=categories_2) { [x,y]; }
all_elements_of_category = ElementsOfCategory(Category=code_block)
flatten = List.Flatten(list=all_elements_of_category)
elementType = Element.ElementType(element=flatten)
code_block_2 = CodeBlock { "Fire Rating"; }
getParameterValueByName = Element.GetParameterValueByName(element=elementType, parameterName=code_block_2)
python_script = Python(IN[0]=flatten, IN[1]=getParameterValueByName)  # CPython3
# ---------- python_script.python (50 lines) ----------
# Load the Python Standard and DesignScript Libraries
import sys
import clr
clr.AddReference('ProtoGeometry')
from Autodesk.DesignScript.Geometry import *

# The inputs to this node will be stored as a list in the IN variables.
dataEnteringNode = IN

# Place your code below this line

# Assign your output to the OUT variable.
OUT = 0


# drill_3A_list_operation_(filter_data)

# data exported from Revit model
elements = IN[0]
fire_ratings = IN[1]

# loop and filter fire-rated data
filtered_results = []

invalid_ratings = ["NR","Not Rated","None","",None]

for element, rating in zip(elements, fire_ratings):
    is_valid_element = False
    if element is not None:
        is_valid_element = True
    
    rating_value_checked = None
    if rating is not None:
        rating_value_checked = str(rating).strip()
    else:
        rating_value_checked = None
    
    is_valid_fire_rating = False
    if is_valid_element:
        if rating_value_checked not in invalid_ratings:
            if rating_value_checked != "":
                is_valid_fire_rating = True
    
    if is_valid_fire_rating:
        element_name = str(element.Name)
        
        result_item = (element_name, rating_value_checked)
        filtered_results.append(result_item)
        
OUT = filtered_results
# ----------------------------------------
