# Dynamo graph 007_drill_3B_list_operation_(list_comprehension).dyn (Dynamo 3.3.0.6316)

categories = Categories("OST_Walls")
all_elements_of_category = ElementsOfCategory(Category=categories)
name = Element.Name(element=all_elements_of_category)
python_script = Python(IN[0]=name)  # CPython3
# ---------- python_script.python (32 lines) ----------
# Load the Python Standard and DesignScript Libraries
import sys
import clr
clr.AddReference('ProtoGeometry')
from Autodesk.DesignScript.Geometry import *

# The inputs to this node will be stored as a list in the IN variables.
dataEnteringNode = IN

# Place your code below this line

# Assign your output to the OUT variable.
OUT = 0


# drill_3B_list_operation_(list_comprehension)

# get the input list of Wall Names from Revit
allwalltype_names = IN[0]

# define filtering criteria (keywords)
fire_keywords = ['Fire', 'Fire-Rated', '1-Hr', '2-Hr', 'Firewall']

# filtering using List Comprehension with IF Condition
non_fire_rated_walls = [
    wall_name for wall_name in allwalltype_names
    if isinstance(wall_name, str) and not any(keyword.lower() in wall_name.lower() for keyword in fire_keywords)
]
# allwalltype_name & fire_keywords are Iterables (source lists)
# wall_name & keyword are Loop Variables

OUT = non_fire_rated_walls
# ----------------------------------------
