# Dynamo graph 008_drill_3C_list_operation_(batch_unit_conversion).dyn (Dynamo 3.3.0.6316)

categories = Categories("OST_StructuralFraming")
all_elements_of_category = ElementsOfCategory(Category=categories)
code_block = CodeBlock { "Length"; }
getParameterValueByName = Element.GetParameterValueByName(element=all_elements_of_category, parameterName=code_block)
python_script = Python(IN[0]=getParameterValueByName)  # CPython3
# ---------- python_script.python (40 lines) ----------
# Load the Python Standard and DesignScript Libraries
import sys
import clr
clr.AddReference('ProtoGeometry')
from Autodesk.DesignScript.Geometry import *

# The inputs to this node will be stored as a list in the IN variables.
dataEnteringNode = IN

# Place your code below this line

# Assign your output to the OUT variable.
OUT = 0


# drill_3C_list_operation_(batch_unit_conversion)

# list of Structural Framing Lengths in raw millimeter
lengths_in_mm_raw = IN[0]


# define function to convert units (Millimeters to Feet)
# round to 0 decimal places for practical construction data
def convert_mm_to_feet(length_in_mm):
    conversion_factor = 0.00328
    return round(length_in_mm * conversion_factor, 0)

# define function to execute batch process with List Comprehension
def get_mto_lengths(lengths_in_mm):
    mto_lengths_feet = [
        convert_mm_to_feet(length)
        for length in lengths_in_mm
        if length >= 3000
    ]
    return mto_lengths_feet

# execute batch process
processed_lengths_feet = get_mto_lengths(lengths_in_mm_raw)

OUT = processed_lengths_feet
# ----------------------------------------
